# Grasshopper definition GetIconFromComponents.gh (Grasshopper 1.0.7)
# plug-ins: MetaHopper

pline = PolyLine(Closed=False)
# Place some components on the canvas, select them, and then hit the "Select" button on the above component.
selobj = GetSelectedObjects(AllObjects_Object=pline)  # -> ComponentObjects, ParamObjects, OtherObjects

icon_save_location = Panel("C:\Yefan\")
componenticon = CSharpScript(x=selobj.ComponentObjects)  # -> out, A
# ---------- componenticon: C# usings ----------
using System.IO;
using System.Linq;
using System.Data;
using System.Drawing;
using System.Reflection;
using System.Windows.Forms;
using System.Xml;
using System.Xml.Linq;
using System.Runtime.InteropServices;

using Rhino.DocObjects;
using Rhino.Collections;
using GH_IO;
using GH_IO.Serialization;
# ---------- componenticon: C# ----------
    IGH_ActiveObject comp = x as IGH_ActiveObject;
    A = comp.Icon_24x24;
# ---------- end componenticon ----------
txt = Text(selobj.ComponentObjects)
save_all_icons = BooleanToggle(True)
format = Format(Format=icon_save_location, Culture=127, Data0=txt)
c_script = CSharpScript(run=save_all_icons, BMP=componenticon.A, savePath=format)  # -> out, A; inputs run: Boolean, savePath: String
# ---------- c_script: C# ----------
    if(!run) return;
    Bitmap bmp = BMP as Bitmap;
    bmp.Save(savePath);
# ---------- end c_script ----------
